# Grasshopper definition edit_TemperatureRelatiHumidity.gh (Grasshopper 1.0.7)

# based on "edit_TemperatureRelatiHumidity.py"
# ======================================
# antonellodinunzio@gmail.com
# INSTRUCTION:
# 
# 1) Go to Food4Rhino and install: Honeybee[+] 0.0.4
# 
# 2) Run this workflow :)
ladybug = Ladybug_Ladybug()  # -> Vviiiiiiiiiizzz; plug-in component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

analysisperiod = LadybugPlus_AnalysisPeriod(startMonth="1", startDay="1", startHour=0, endMonth="1", endDay="1")  # -> analysisPeriod, hoys, dates; plug-in component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

# ---- group: Legacy
open_weather_file = Ladybug_OpenEPWWeatherFile(open=Toggle(True))  # -> epwFile; plug-in component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

# ----
lng = ListLength(List=analysisperiod.hoys)
dup = DuplicateData(Data="45", Number=lng, Order=True)

edit_temperaturerelatihumidity = LadybugPlus_EditTemperatureRelativeHumidity(runIt=Toggle(False), epwFile=open_weather_file, analysisPeriod=analysisperiod.analysisPeriod, index="0", listValues=dup)  # -> out, newFile; plug-in component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

panel = Panel(edit_temperaturerelatihumidity.out)
importepw = LadybugPlus_ImportEPW(epwFile=edit_temperaturerelatihumidity.newFile)  # -> report, location, dryBulbTemperature, dewPointTemperature, relativeHumidity, windSpeed, windDirection, directNormalRadiation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; plug-in component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

# ---- group: Legacy
strnum = Ladybug_SeparateData(inputList=flatten(importepw.dryBulbTemperature))  # -> numbers, strings; plug-in component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
graph = QuickGraph(strnum.numbers, SortOrder=0)
